# Grasshopper definition cloth_trial.gh (Grasshopper 1.0.7)
# plug-ins: Weaverbird

number_slider = Slider(5.4, range=0..20)
number_slider_2 = Slider(9.6, range=1..20)
yz_plane = YZPlane(Origin=Point(0, 0, 0))
multiplication = Multiplication(A=number_slider, B="0")
multiplication_2 = Multiplication(A=number_slider, B="1")
multiplication_3 = Multiplication(A=number_slider, B="2")
multiplication_4 = Multiplication(A=number_slider, B="3")
multiplication_5 = Multiplication(A=number_slider, B="4")
number_slider_3 = Slider(2.7, range=1..20)
panel = Panel("""-4
-3
-2
-1
0
1
2
3
4""")
panel_2 = Panel("""0
1
2
3
4""")
multiplication_6 = Multiplication(A=panel, B=Slider(5.4, range=0..10))
multiplication_7 = Multiplication(A=panel_2, B=number_slider_3)  # -> graft(Result)
integer = Integer(4)
multiplication_8 = Multiplication(A="-4", B=number_slider_2)
multiplication_9 = Multiplication(A="-3", B=number_slider_2)
multiplication_10 = Multiplication(A="-2", B=number_slider_2)
multiplication_11 = Multiplication(A="-1", B=number_slider_2)
multiplication_12 = Multiplication(A="0", B=number_slider_2)
multiplication_13 = Multiplication(A="1", B=number_slider_2)
multiplication_14 = Multiplication(A="2", B=number_slider_2)
multiplication_15 = Multiplication(A="3", B=number_slider_2)
multiplication_16 = Multiplication(A="4", B=number_slider_2)
multiplication_17 = Multiplication(A=number_slider_3, B=integer)
vector_xyz = VectorXYZ(XComponent=multiplication_6, YComponent=multiplication_7, ZComponent=0)  # -> Vector, Length
point = Point(flatten(vector_xyz.Vector))
point_list = PointList(Points=point, Size=Slider(0.7, range=0..10))
panel_3 = Panel(point)
vector_xyz_2 = VectorXYZ(XComponent=multiplication_8, YComponent=multiplication, ZComponent=0)  # -> Vector, Length
vector_xyz_3 = VectorXYZ(XComponent=multiplication_9, YComponent=multiplication, ZComponent=0)  # -> Vector, Length
vector_xyz_4 = VectorXYZ(XComponent=multiplication_10, YComponent=multiplication, ZComponent=0)  # -> Vector, Length
vector_xyz_5 = VectorXYZ(XComponent=multiplication_11, YComponent=multiplication, ZComponent=0)  # -> Vector, Length
vector_xyz_6 = VectorXYZ(XComponent=multiplication_12, YComponent=multiplication, ZComponent=0)  # -> Vector, Length
timer = Timer(TimerInterval=1000, Target=runner_python)  # disabled

concatenate = Concatenate(FragmentA=panel_3, FragmentB="/")
partition_list = PartitionList(List=concatenate, Size="45")
text_join = TextJoin(Text=partition_list)

runner_python = GhPythonScript(loop=Toggle(False), reset=Toggle(True))  # -> out
# ---------- runner_python: Python ----------
__author__ = "jiang"
__version__ = "2019.11.20"

import rhinoscriptsyntax as rs

import scriptcontext as sc
from time import sleep

for i in range(10):
    out = i

print(out)
# ---------- end runner_python ----------

point_2 = Point(vector_xyz_5.Vector)
point_3 = Point(vector_xyz_2.Vector)
point_4 = Point(vector_xyz_3.Vector)
point_5 = Point(vector_xyz_4.Vector)

_1e = Mirror(Geometry=point_2, Plane=yz_plane)  # -> Geometry, Transform
_2e = Mirror(Geometry=point_5, Plane=yz_plane)  # -> Geometry, Transform
_3e = Mirror(Geometry=point_4, Plane=yz_plane)  # -> Geometry, Transform
_4e = Mirror(Geometry=point_3, Plane=yz_plane)  # -> Geometry, Transform
panel_4 = Panel(point_3)
panel_5 = Panel(runner_python)
speed = Slider(0.29, range=0..1)
bio_random = Slider(0.07, range=0..0.5)
dropto = Slider(0.56, range=0..0.9)
trial = Slider(9, range=1..10)
vector_xyz_7 = VectorXYZ(XComponent=multiplication_8, YComponent=multiplication_2, ZComponent=0)  # -> Vector, Length
vector_xyz_8 = VectorXYZ(XComponent=multiplication_9, YComponent=multiplication_2, ZComponent=0)  # -> Vector, Length
vector_xyz_9 = VectorXYZ(XComponent=multiplication_10, YComponent=multiplication_2, ZComponent=0)  # -> Vector, Length
vector_xyz_10 = VectorXYZ(XComponent=multiplication_11, YComponent=multiplication_2, ZComponent=0)  # -> Vector, Length
vector_xyz_11 = VectorXYZ(XComponent=multiplication_12, YComponent=multiplication_2, ZComponent=0)  # -> Vector, Length
kernel = Panel("36,1,-0.1,-0.1/27,1,0,0/18,1,-0.1,-0.1/9,1,0,-0.1/0,1,-0.1,-0.1/37,1,0,0/28,1,0,1/19,1,0,1/10,1,0,1/1,1,0,1/3,1,0,0.5/12,1,-0.1,0.5/21,1,0,0.5/30,1,-0.1,0.5/39,1,0,0/38,0,0,-1.2/29,0,0,-1.5/20,0,0,-1.8/11,0,0,-1.5/2,0,0,-1/32,-0.3,-0.1,-0.5/14,-0.3,-0.1,-0.5/6,-0.3,-0.1,0")

point_6 = Point(vector_xyz_10.Vector)
point_7 = Point(vector_xyz_7.Vector)
point_8 = Point(vector_xyz_8.Vector)
point_9 = Point(vector_xyz_9.Vector)

_1d = Mirror(Geometry=point_6, Plane=yz_plane)  # -> Geometry, Transform
_2d = Mirror(Geometry=point_9, Plane=yz_plane)  # -> Geometry, Transform
_3d = Mirror(Geometry=point_8, Plane=yz_plane)  # -> Geometry, Transform
_4d = Mirror(Geometry=point_7, Plane=yz_plane)  # -> Geometry, Transform
transform = GhPythonScript(original_positions=text_join, kernel=kernel, speed=speed, drop=dropto, trial=trial, bio=bio_random)  # -> distance, lineList
# ---------- transform: Python ----------
"""Provides a scripting component.
    Inputs:
        original_positions
        kernel
        speed
        drop
        trail
    Output:
        a: The a output variable"""
        
__author__ = "jiang"
__version__ = "2019.11.19"
        
import rhinoscriptsyntax as rs
import GhPython as gh

import scriptcontext
import random

rs.EnableRedraw(True)
        
lineList = []
toMove = {}

def make_positionList(o_positions):
    pL = []
    op = o_positions[1:-2]
    op = op.split('}/{')
    for p in op:
        tempp = p.split(',')
        for i in range(3):
            if tempp[i] == '0':
                tempp[i] = 0
            else:
                tempp[i] = float(tempp[i])
        pL.append(tempp)
    return pL
    
def find_neighbors(selfInd):
    returner = set()
    if selfInd - 9 >= 0:
        returner.add(selfInd - 9)
    if selfInd + 9 <= 44:
        returner.add(selfInd + 9)
    if selfInd % 9 != 0:
        returner.add(selfInd - 1)
    if (selfInd - 8) % 9 != 0:
        returner.add(selfInd + 1)
    return returner
    
def bio_random(biok):
    if biok == 0:
        return bio * random.random()
    else:
        return bio * random.random() * (biok / abs(biok))
    
class Node:
    def __init__(self, ind, neighbors, position):
        self.ind = ind
        self.neighbors = neighbors
        self.x = position[0]
        self.y = position[1]
        self.z = position[2]
        
    def move(self, level, kernelList):
        self.x = self.x + kernelList[0] * speed + bio_random(kernelList[0])
        self.y = self.y + kernelList[1] * speed + bio_random(kernelList[1])
        self.z = self.z + kernelList[2] * speed + bio_random(kernelList[2])
        # Recursively move neighbors
        if abs(max(kernelList)) > 0.01:
            if (level + 1) not in moved:
                moved[level + 1] = set()
                
            for n in self.neighbors:
                if n not in moved[level + 1]:
                    moved[level + 1].add(n)
                    nodeList[n].move(level + 1, [kernelList[0] * drop, kernelList[1] * drop, kernelList[2] * drop])
    
if __name__ == "__main__":
    pl = make_positionList(original_positions) # positionLit
    nodeList = []
    for p in range(len(pl)):
        tempNeighbors = find_neighbors(p) # list
        nodeList.append(Node(p, tempNeighbors, pl[p]))
    
    # Process kernel
    kList = kernel.split('/') # list
    for k in kList:
        k = k.split(',')
        toMove[int(k[0])] = [float(k[1]), float(k[2]), float(k[3])]
        
    # Move
    for t in range(int(trial)):
        moved = {}
        moved[0] = set()
        for startNodeInd in toMove:
            moved[0].add(startNodeInd)
            nodeList[startNodeInd].move(0, toMove[startNodeInd])
            
    # Draw lines
    # Vertical
    for i in range(0, 4):
        for j in range(0, 9):
            startInd = i * 9 + j
            sNode = nodeList[startInd]
            endInd = (i + 1) * 9 + j
            eNode = nodeList[endInd]
            tempLine = rs.AddLine([sNode.x, sNode.y, sNode.z], [eNode.x, eNode.y, eNode.z])
            lineList.append(tempLine)
    # Horizontal
    for i in range(0, 8):
        for j in range(0, 5):
            startInd = i + 9 * j
            sNode = nodeList[startInd]
            endInd = i + 1 + 9 * j
            eNode = nodeList[endInd]
            tempLine = rs.AddLine([sNode.x, sNode.y, sNode.z], [eNode.x, eNode.y, eNode.z])
            lineList.append(tempLine)
# ---------- end transform ----------
move = Move(Motion=Vector(0, 0, 10))  # -> Geometry, Transform
line = Line(transform.lineList)
point_on_curve = PointOnCurve(line, parameter=0.5)
vector_xyz_12 = VectorXYZ(XComponent=multiplication_8, YComponent=multiplication_3, ZComponent=0)  # -> Vector, Length
vector_xyz_13 = VectorXYZ(XComponent=multiplication_9, YComponent=multiplication_3, ZComponent=0)  # -> Vector, Length
vector_xyz_14 = VectorXYZ(XComponent=multiplication_10, YComponent=multiplication_3, ZComponent=0)  # -> Vector, Length
vector_xyz_15 = VectorXYZ(XComponent=multiplication_11, YComponent=multiplication_3, ZComponent=0)  # -> Vector, Length
vector_xyz_16 = VectorXYZ(XComponent=multiplication_12, YComponent=multiplication_3, ZComponent=0)  # -> Vector, Length
weaverbird_s_mesh_from_lines_weave_back = WeaverbirdsMeshFromLinesWeaveBack(Lines=line, MaximumValence=4)

point_10 = Point(vector_xyz_13.Vector)
point_11 = Point(vector_xyz_12.Vector)
point_12 = Point(vector_xyz_14.Vector)
point_13 = Point(vector_xyz_15.Vector)

_1c = Mirror(Geometry=point_13, Plane=yz_plane)  # -> Geometry, Transform
_2c = Mirror(Geometry=point_12, Plane=yz_plane)  # -> Geometry, Transform
_3c = Mirror(Geometry=point_10, Plane=yz_plane)  # -> Geometry, Transform
_4c = Mirror(Geometry=point_11, Plane=yz_plane)  # -> Geometry, Transform
weaverbird_s_catmull_clark_subdivision = WeaverbirdsCatmullClarkSubdivision(MeshCurves=weaverbird_s_mesh_from_lines_weave_back, Level=Slider(1, range=0..10), SmoothNakedEdges=0)
vector_xyz_17 = VectorXYZ(XComponent=multiplication_8, YComponent=multiplication_4, ZComponent=0)  # -> Vector, Length
vector_xyz_18 = VectorXYZ(XComponent=multiplication_9, YComponent=multiplication_4, ZComponent=0)  # -> Vector, Length
vector_xyz_19 = VectorXYZ(XComponent=multiplication_10, YComponent=multiplication_4, ZComponent=0)  # -> Vector, Length
vector_xyz_20 = VectorXYZ(XComponent=multiplication_11, YComponent=multiplication_4, ZComponent=0)  # -> Vector, Length
vector_xyz_21 = VectorXYZ(XComponent=multiplication_12, YComponent=multiplication_4, ZComponent=0)  # -> Vector, Length

point_14 = Point(vector_xyz_17.Vector)
point_15 = Point(vector_xyz_18.Vector)
point_16 = Point(vector_xyz_19.Vector)
point_17 = Point(vector_xyz_20.Vector)

_1b = Mirror(Geometry=point_17, Plane=yz_plane)  # -> Geometry, Transform
_2b = Mirror(Geometry=point_16, Plane=yz_plane)  # -> Geometry, Transform
_3b = Mirror(Geometry=point_15, Plane=yz_plane)  # -> Geometry, Transform
_4b = Mirror(Geometry=point_14, Plane=yz_plane)  # -> Geometry, Transform
weaverbird_s_mesh_thicken = WeaverbirdsMeshThicken(MeshCurves=weaverbird_s_catmull_clark_subdivision, Distance=Slider(0.45, range=0..5), OffsetType=0)
vector_xyz_22 = VectorXYZ(XComponent=multiplication_8, YComponent=multiplication_5, ZComponent=0)  # -> Vector, Length
vector_xyz_23 = VectorXYZ(XComponent=multiplication_9, YComponent=multiplication_5, ZComponent=0)  # -> Vector, Length
vector_xyz_24 = VectorXYZ(XComponent=multiplication_10, YComponent=multiplication_5, ZComponent=0)  # -> Vector, Length
vector_xyz_25 = VectorXYZ(XComponent=multiplication_11, YComponent=multiplication_5, ZComponent=0)  # -> Vector, Length
vector_xyz_26 = VectorXYZ(XComponent=multiplication_12, YComponent=multiplication_5, ZComponent=0)  # -> Vector, Length
weaverbird_s_loop_subdivision = WeaverbirdsLoopSubdivision(MeshCurves=weaverbird_s_mesh_thicken, Level=Slider(3, range=1..5), SmoothNakedEdges=1)
unit_y = UnitY(Factor=multiplication_17)

point_18 = Point(vector_xyz_22.Vector)
point_19 = Point(vector_xyz_23.Vector)
point_20 = Point(vector_xyz_24.Vector)
point_21 = Point(vector_xyz_25.Vector)

_1a = Mirror(Geometry=point_21, Plane=yz_plane)  # -> Geometry, Transform
_2a = Mirror(Geometry=point_20, Plane=yz_plane)  # -> Geometry, Transform
_3a = Mirror(Geometry=point_19, Plane=yz_plane)  # -> Geometry, Transform
_4a = Mirror(Geometry=point_18, Plane=yz_plane)  # -> Geometry, Transform
xz_plane = XZPlane(Origin=unit_y)

number_slider_4 = Slider(0.462, range=0..0.5)  # disabled
number_slider_5 = Slider(0.21, range=0..1)  # disabled
number_slider_6 = Slider(0.679, range=0..1)  # disabled
number_slider_7 = Slider(0.207, range=0..0.3)  # disabled
weave = Weave(G=weaverbird_s_catmull_clark_subdivision, T0=number_slider_4, T1=number_slider_6, D=number_slider_5, Q=True)  # -> out, A; inputs G: GeometryBase, I: list, T0: list, T1: list, D: list, Q: list, clr: list of Color; disabled
# ---------- weave: VB ----------
    Component.Params.Input(0).Name = "Mesh or Curve"
    Component.Params.Input(0).Description = "Open or closed mesh or curve"
    Component.Params.Input(1).Name = "Index [Face]"
    Component.Params.Input(1).Description = "An optional integer or list of integers which specify the faces to be modified if the input is a mesh. If no value is supplied then all faces will be modified"
    Component.Params.Input(2).Name = "Edge Width [Vertex]"
    Component.Params.Input(2).Description = "Evaluated width of the new mesh face a the edge"
    Component.Params.Input(3).Name = "Face Width [Vertex]"
    Component.Params.Input(3).Description = "Evaluated width of the new mesh face at the center"
    Component.Params.Input(4).Name = "Distance [Vertex]"
    Component.Params.Input(4).Description = "An optional number or list of numbers for the offset value from the existing face"
    Component.Params.Input(5).Name = "Quads [Face]"
    Component.Params.Input(5).Description = "An optional boolean or list of boolean values which specifies if the new faces will be quads if true or triangles if false"
    Component.Params.Input(6).Name = "Colors [Vertex]"
    Component.Params.Input(6).Description = "(If applied to a mesh a list of colors corresponding to each mesh vertex, if applied to a curve, a list of colors corresponding to each control point plus an additonal color value for the new averaged center"

    Component.Params.Output(1).Name = "Mesh"
    Component.Params.Output(1).Description = "If successful, a valid mesh"

    If g IsNot Nothing Then
      Dim j,k,kk,n,t,v,w,cnt As Integer
      Dim u() As Integer = Nothing
      Dim tint() As Integer = Nothing
      Dim mo As New mesh
      Dim ov,cv As New list(Of Point3d)
      Dim ofc As New list(Of meshface)
      Dim oc,oca As New list(Of color)

      Dim blnM, blnC As Boolean

      Dim cen As point3d
      Dim vec As Vector3d
      Dim clrB As Boolean
      Dim avgClr,avgClrC As color

      blnM = g.ObjectType = ObjectType.Mesh
      blnC = g.ObjectType = ObjectType.Curve

      'Declare Mesh Variables
      Dim m As mesh
      Dim mf As Rhino.Geometry.Collections.MeshFaceList = Nothing
      Dim mv As Rhino.Geometry.Collections.MeshVertexList = Nothing
      Dim mtv As Rhino.Geometry.Collections.MeshTopologyVertexList = Nothing
      Dim mn As Rhino.Geometry.Collections.MeshFaceNormalList = Nothing
      Dim mc As Rhino.Geometry.Collections.MeshVertexColorList

      'Declare Curve Variables
      Dim crv As curve
      Dim ncrv As nurbsCurve
      Dim npts As rhino.Geometry.Collections.NurbsCurvePointList
      Dim vs() As vector3f

      If (blnM Or blnC) Then

        If blnM Then
          'Start Deconstruct if Mesh
          m = g
          m.Normals.ComputeNormals()
          m.FaceNormals.ComputeFaceNormals()
          mf = m.Faces
          mv = m.Vertices
          mtv = m.TopologyVertices
          mn = m.FaceNormals
          mc = m.VertexColors

          'Check Mesh Color Status
          If ((m.VertexColors.count() <> 0) Or (clr.count() <> 0)) Then clrB = True
          If ((m.VertexColors.count() = 0) And (clr.count() <> 0)) Then mc.CreateMonotoneMesh(color.LightGray)

          'Populate Vertex/ Color Lists
          oc = mc.ToArray().ToList()
        Else
          'Start Deconstruct if Curve
          crv = g
          ncrv = crv.ToNurbsCurve()
          npts = ncrv.Points
          Dim pline As Polyline = ncrv.Points.ControlPolygon
          Dim cmsh As New mesh
          cmsh.Vertices.AddVertices(pline.ToArray())
          cmsh.faces.addfaces(pline.TriangulateClosedPolyline())
          cmsh.Normals.ComputeNormals()
          cmsh.Normals.UnitizeNormals

          cv = pline.ToArray().ToList()
          If crv.IsClosed() Then cv.RemoveAt(pline.count() - 1)

          v = cv.Count() - 1
          If Not crv.IsClosed() Then v += 1
          u = appendprepend(v)
          w = -1
          vs = cmsh.Normals.ToArray()

          For j = 0 To v Step 1
            vec += vs(u(j))
            If (clr.count() > 0) Then If j > (clr.count() - 1) Then oc.add(clr.item(clr.count() - 1)) Else oc.add(clr.item(j))
          Next
          vec /= v
          vec.Unitize
          cen = pline.CenterPoint
        End If

        'Check clr input status
        If clr.count() <> 0 Then clrB = True

      End If

      If blnM Then If i.count() > 0 Then cnt = i.count() Else cnt = mf.count() Else cnt = 1
      For n = 0 To cnt - 1 Step 1
        If blnM Then
          If i.count() > 0 Then j = i.item(n) Else j = n

          tint = mf.GetTopologicalVertices(j)
          cen = mf.GetFaceCenter(j)
          vec = mn.item(j)

          If mf(j).isquad() Then v = 3 Else v = 2
          u = appendprepend(v)
          w = ov.count() - 1
        Else
          j = n
        End If
        vec.Unitize()

        t = 6

        Dim avgD As Double = 0

        If clrB Then
          Dim tt As Integer
          Dim aR,aG,aB,bR,bG,bB As New Double
          For k = 0 To v Step 1
            If blnM Then tt = mtv.MeshVertexIndices(tint(k))(0) Else tt = k
            aR += oc.item(tt).R
            aG += oc.item(tt).G
            aB += oc.item(tt).B
            If clr.count() > 0 Then
              If tt > (clr.count() - 1) Then tt = clr.count() - 1
              bR += clr.item(tt).R
              bG += clr.item(tt).G
              bB += clr.item(tt).B
            End If
          Next

          If (blnM Or ((clr.count() - 1) <= v)) Then avgClr = avgC(aR, aG, aB, v + 1) Else avgClr = clr.item(clr.count() - 1)
          If (blnM Or ((clr.count() - 1) <= v)) Then avgClrC = avgC(bR, bG, bB, v + 1) Else avgClrC = clr.item(clr.count() - 1)
        End If

        For k = 1 To v + 1  Step 1
          'Keep distance and t values from exceeding list lengths
          Dim p(2) As point3d
          Dim tv(2) As Integer
          Dim da(2),ta0(2),ta1(2),qa(2) As Double
          Dim tc(2) As color

          For kk = 0 To 2 Step 1
            If blnM Then
              tv(kk) = mtv.MeshVertexIndices(tint(u(k + kk - 1)))(0)
              p(kk) = New point3d(mv(tv(kk)))
            Else
              tv(kk) = u(k + kk - 1)
              p(kk) = New point3d(cv(tv(kk)))
            End If

            If tv(kk) > (d.count() - 1) Then da(kk) = d.item(d.count() - 1) Else da(kk) = d.item(tv(kk))
            If tv(kk) > (q.count() - 1) Then qa(kk) = q.item(q.count() - 1) Else qa(kk) = q.item(tv(kk))
            If tv(kk) > (t0.count() - 1) Then ta0(kk) = t0.item(t0.count() - 1) Else ta0(kk) = t0.item(tv(kk))
            If tv(kk) > (t1.count() - 1) Then ta1(kk) = t1.item(t1.count() - 1) Else ta1(kk) = t1.item(tv(kk))
            If clr.count() > 0 Then If tv(kk) > (clr.count() - 1) Then tc(kk) = clr.item(clr.count() - 1) Else tc(kk) = clr.item(tv(kk))

          Next

          'Define Vertices
          Dim pA(1),pB(1),pC As point3d
          Dim vA(1) As Vector3d

          pA(0) = (p(0) + p(1)) / 2
          pA(1) = (p(1) + p(2)) / 2
          pB(0) = (p(1) + pA(1)) / 2
          pB(1) = (p(2) + pA(1)) / 2

          pC = evalP(cen, pA(0), (ta1(0) + ta1(1)) / 2)

          ov.add(evalP(pB(0), p(1), ta0(1)))
          ov.add(evalP(pB(0), pA(1), ta0(1)))
          ov.add(evalP(pB(1), p(2), ta0(2)))
          ov.add(evalP(pB(1), pA(1), ta0(2)))
          ov.add(pC + New point3d(vec * ((da(0) + da(1)) / 2)))
          ov.add(pC + New point3d(vec * ((-da(0) - da(1)) / 2)))

          'Define Faces
          If qa(1) Then
            ofc.Add(New meshface(w + u(k) * t + 1, w + u(k) * t + 2, w + u(k + 1) * t + 5, w + u(k) * t + 5))
            ofc.Add(New meshface(w + u(k - 1) * t + 4, w + u(k - 1) * t + 3, w + u(k + 1) * t + 6, w + u(k) * t + 6))
          Else
            ofc.Add(New meshface(w + u(k) * t + 1, w + u(k) * t + 2, w + u(k + 1) * t + 5))
            ofc.Add(New meshface(w + u(k) * t + 1, w + u(k + 1) * t + 5, w + u(k) * t + 5))
            ofc.Add(New meshface(w + u(k - 1) * t + 4, w + u(k - 1) * t + 3, w + u(k + 1) * t + 6))
            ofc.Add(New meshface(w + u(k - 1) * t + 4, w + u(k + 1) * t + 6, w + u(k) * t + 6))
          End If
          If v > 3 Then
            ofc.Add(New meshface(w + u(k) * t + 5, w + u(k + 1) * t + 5, w + t * (v + 1) + 1))
            ofc.Add(New meshface(w + u(k) * t + 6, w + u(k + 1) * t + 6, w + t * (v + 1) + 2))
          End If
          avgD += da(0)
          'Define Vertex Colors
          If clrB Then
            Dim clB As Boolean = (blnC And ((clr.count() - 1) > v))
            Dim tclr(3) As color
            tclr(0) = evalC(oc.item(tv(1)), oc.item(tv(2)), 0.25)
            tclr(1) = evalC(oc.item(tv(1)), oc.item(tv(2)), 0.5)
            tclr(2) = evalC(oc.item(tv(1)), oc.item(tv(2)), 0.75)
            tclr(3) = evalC(oc.item(tv(0)), oc.item(tv(1)), 0.5)

            oca.add(evalC(tclr(0), oc.item(tv(1)), ta0(1)))
            oca.add(evalC(tclr(0), tclr(1), ta0(0)))

            oca.add(evalC(tclr(2), oc.item(tv(2)), ta0(2)))
            oca.add(evalC(tclr(2), tclr(1), ta0(1)))

            If clr.count() > 0 Then oca.add(avgClrC) Else oca.add(evalC(avgClr, tclr(3), (ta1(0) + ta1(1)) / 2))
            If clr.count() > 0 Then oca.add(avgClrC) Else oca.add(evalC(avgClr, tclr(3), (ta1(0) + ta1(1)) / 2))
          End If
        Next

        avgD /= (v + 1)
        If v = 2 Then
          ofc.Add(New meshface(w + 5, w + 11, w + 17))
          ofc.Add(New meshface(w + 12, w + 18, w + 6))
        ElseIf v = 3 Then
          ofc.Add(New meshface(w + 5, w + 11, w + 17, w + 23))
          ofc.Add(New meshface(w + 12, w + 18, w + 24, w + 6))
        ElseIf v > 3 Then
          ov.add(cen + vec * avgD)
          ov.add(cen + vec * -avgD)
          oca.add(avgclr)
          oca.add(avgclr)
        End If
      Next

      mo.Vertices.AddVertices(ov.toarray())
      If clrB Then mo.VertexColors.AppendColors(oca.toarray())
      mo.Faces.AddFaces(ofc.toarray())
      A = mo

    End If
# ---------- weave: VB additional code ----------
  Private Function appendprepend(ByVal i As Integer)
    Dim srsEnum As IEnumerable(Of Integer) = Enumerable.Range(0, i + 1)
    Dim arrVal As New list(Of Integer)
    arrVal = srsEnum.tolist()
    arrVal.add(0)
    arrVal.insert(0, i)
    Return arrVal.toarray()
  End Function

  Private Function evalP(ByVal op As point3d, ByVal tp As Point3d, ByVal t As Double)

    Return New point3d(op + (tp - op) * t)
  End Function

  Private Function evalC(ByVal oc As color, ByVal tc As color, ByVal t As Double)
    Dim r,g,b As Integer
    r = CInt(CInt(oc.R) + (CInt(tc.R) - CInt(oc.R)) * t)
    g = CInt(CInt(oc.G) + (CInt(tc.G) - CInt(oc.G)) * t)
    b = CInt(CInt(oc.B) + (CInt(tc.B) - CInt(oc.B)) * t)

    If r > 255 Then r = 255 Else If r < 0 Then r = 0
    If g > 255 Then g = 255 Else If g < 0 Then g = 0
    If b > 255 Then b = 255 Else If b < 0 Then b = 0

    Return color.FromArgb(r, g, b)
  End Function

  Private Function avgC(ByVal R As Double, ByVal G As Double, ByVal B As Double, ByVal T As Integer)

    R /= t
    G /= t
    B /= t
    If R > 255 Then R = 255 Else If R < 0 Then R = 0
    If G > 255 Then G = 255 Else If G < 0 Then G = 0
    If B > 255 Then B = 255 Else If B < 0 Then B = 0

    Return color.FromArgb(CInt(R), CInt(G), CInt(B))
  End Function
# ---------- end weave ----------
weaverbird_s_mesh_thicken_2 = WeaverbirdsMeshThicken(MeshCurves=weave.A, Distance=number_slider_7, OffsetType=0)  # disabled
number_slider_8 = Slider(2, range=1..3)  # disabled
weaverbird_s_catmull_clark_subdivision_2 = WeaverbirdsCatmullClarkSubdivision(MeshCurves=weaverbird_s_mesh_thicken_2, Level=number_slider_8, SmoothNakedEdges=1)  # disabled
mirror = Mirror(Geometry=weaverbird_s_catmull_clark_subdivision_2, Plane=xz_plane)  # -> Geometry, Transform; disabled
mesh = Mesh([weaverbird_s_catmull_clark_subdivision_2, mirror.Geometry])  # disabled

# ---- group: Points for Lines
_4a_2 = Point([point_18, _4a.Geometry])
_3a_2 = Point([point_19, _3a.Geometry])
_2a_2 = Point([point_20, _2a.Geometry])
_1a_2 = Point([point_21, _1a.Geometry])
_0a = Point(vector_xyz_26.Vector)

_4b_2 = Point([point_14, _4b.Geometry])
_3b_2 = Point([point_15, _3b.Geometry])
_2b_2 = Point([point_16, _2b.Geometry])
_1b_2 = Point([point_17, _1b.Geometry])
_0b = Point(vector_xyz_21.Vector)

_4c_2 = Point([point_11, _4c.Geometry])
_3c_2 = Point([point_10, _3c.Geometry])
_2c_2 = Point([point_12, _2c.Geometry])
_1c_2 = Point([point_13, _1c.Geometry])
_0c = Point(vector_xyz_16.Vector)

_4d_2 = Point([point_7, _4d.Geometry])
_3d_2 = Point([point_8, _3d.Geometry])
_2d_2 = Point([point_9, _2d.Geometry])
_1d_2 = Point([point_6, _1d.Geometry])
_0d = Point(vector_xyz_11.Vector)

_4e_2 = Point([point_3, _4e.Geometry])
_3e_2 = Point([point_4, _3e.Geometry])
_2e_2 = Point([point_5, _2e.Geometry])
_1e_2 = Point([point_2, _1e.Geometry])
_0e = Point(vector_xyz_6.Vector)

# ----
line_2 = Line(StartPoint=[_4a_2, _3a_2, _2a_2, _1a_2, _0a], EndPoint=[_4b_2, _3b_2, _2b_2, _1b_2, _0b])
line_3 = Line(StartPoint=[_4b_2, _3b_2, _2b_2, _1b_2, _0b], EndPoint=[_4c_2, _3c_2, _2c_2, _1c_2, _0c])
line_4 = Line(StartPoint=[_4c_2, _3c_2, _2c_2, _1c_2, _0c], EndPoint=[_4d_2, _3d_2, _2d_2, _1d_2, _0d])
line_5 = Line(StartPoint=[_4d_2, _3d_2, _2d_2, _1d_2, _0d], EndPoint=[_4e_2, _3e_2, _2e_2, _1e_2, _0e])
construct_domain = ConstructDomain(DomainStart=0, DomainEnd=1)
create_material = CreateMaterial(
    Diffuse=ColourSwatch(SwatchColor=RGB(255, 255, 255)),
    Specular=ColourSwatch(SwatchColor=RGB(255, 255, 255)),
    Emission=RGB(0, 0, 0),
    Transparency=0,
    Shine=Slider(0, range=0..50))
mirror_2 = Mirror(Geometry=weaverbird_s_loop_subdivision, Plane=xz_plane)  # -> Geometry, Transform
mesh_2 = Mesh([weaverbird_s_loop_subdivision, mirror_2.Geometry])
vector_xyz_27 = VectorXYZ(XComponent=Slider(0.8, range=-1..1), YComponent=Slider(0, range=-1..1), ZComponent=Slider(-0.8, range=-1..1))  # -> Vector, Length
custom_preview = CustomPreview(Geometry=mesh_2, Material=create_material)
line_6 = Line(StartPoint=[_4a_2, _4b_2, _4c_2, _4d_2, _4e_2], EndPoint=[_3a_2, _3b_2, _3c_2, _3d_2, _3e_2])
line_7 = Line(StartPoint=[_3a_2, _3b_2, _3c_2, _3d_2, _3e_2], EndPoint=[_2a_2, _2b_2, _2c_2, _2d_2, _2e_2])
line_8 = Line(StartPoint=[_2a_2, _2b_2, _2c_2, _2d_2, _2e_2], EndPoint=[_1a_2, _1b_2, _1c_2, _1d_2, _1e_2])
line_9 = Line(StartPoint=_1a_2, EndPoint=_0a)
line_10 = Line(StartPoint=_1b_2, EndPoint=_0b)
line_11 = Line(StartPoint=_1c_2, EndPoint=_0c)
line_12 = Line(StartPoint=_1d_2, EndPoint=_0d)
line_13 = Line(StartPoint=_1e_2, EndPoint=_0e)
list_item = ListItem(List=point, Index=0, Wrap=True)  # disabled
mesh_shadow = MeshShadow(Mesh=weaverbird_s_catmull_clark_subdivision, Light=vector_xyz_27.Vector, Plane=PlaneXY(0, 0, 0))  # -> flatten(Outlines); disabled
vector_display = VectorDisplay(Anchor=list_item, Vector=vector_xyz_27.Vector)  # disabled
point_22 = Point([_4a_2, _3a_2, _2a_2, _1a_2, _0a, _4b_2, _3b_2, _2b_2, _1b_2, _0b, _4c_2, _3c_2, _2c_2, _1c_2, _0c, _4d_2, _3d_2, _2d_2, _1d_2, _0d, _4e_2, _3e_2, _2e_2, _1e_2, _0e])
panel_6 = Panel(point_22)
line_14 = Line([line_6, line_7, line_8, line_9, line_10, line_11, line_12, line_13])
line_15 = Line([line_2, line_3, line_4, line_5])
patch = Patch(Curves=mesh_shadow, Spans=20, Flexibility=1, Trim=True)  # disabled
create_material_2 = CreateMaterial(
    Diffuse=ColourSwatch(SwatchColor=RGBA(191, 191, 191, 145)),
    Specular=RGB(255, 255, 255),
    Emission=RGB(0, 0, 0),
    Transparency=0,
    Shine=0)
unit_z = UnitZ(Factor=Slider(-0.4, range=-1..0))
mirror_3 = Mirror(Geometry=patch, Plane=xz_plane)  # -> Geometry, Transform; disabled
concatenate_2 = Concatenate(FragmentA=panel_6, FragmentB="/")
point_list_2 = PointList(Points=point_22, Size=Slider(2, range=0..5))
move_2 = Move(Geometry=mirror_3.Geometry, Motion=unit_z)  # -> Geometry, Transform
partition_list_2 = PartitionList(List=concatenate_2, Size="45")
text_join_2 = TextJoin(Text=partition_list_2)
shadow = CustomPreview(Geometry=move_2.Geometry, Material=create_material_2)
construct_domain_2 = ConstructDomain(DomainStart=Slider(0.2, range=0..2.5), DomainEnd=Slider(2, range=0..2.5))

mcomp = Decompose(Mesh=mesh_2)  # -> Vertices, Faces, Colours, Normals
pcomp = Decompose(Point=mcomp.Vertices)  # -> XComponent, YComponent, flatten(ZComponent)
bounds = Bounds(Numbers=pcomp.ZComponent)
remap_numbers = RemapNumbers(Value=pcomp.ZComponent, Source=construct_domain_2, Target=Domain(0, 1))  # -> Mapped, Clipped
gradient = Gradient(
    LowerLimit=0,
    UpperLimit=1,
    Parameter=remap_numbers.Mapped,
    stops=[0: RGB(176, 196, 222), 0.25: RGB(224, 255, 255), 0.5: RGB(255, 250, 205), 0.75: RGB(255, 192, 128), 1: RGB(255, 128, 128)])
mesh_3 = Mesh(Vertices=mcomp.Vertices, Faces=mcomp.Faces, Colours=gradient)

panel_7 = Panel(bounds)
