# Grasshopper definition runway_1.gh (Grasshopper 1.0.7)
# plug-ins: ghJSON

# ---- group: HTTP Request
timer = Timer(TimerInterval=1000, Target=c_script)
c_script = CSharpScript(url="http://localhost:8000/data", read=Toggle(True))  # -> out, A; inputs url: String, read: Boolean
# ---------- c_script: C# usings ----------
using System.IO;
using System.Linq;
using System.Data;
using System.Drawing;
using System.Reflection;
using System.Windows.Forms;
using System.Xml;
using System.Xml.Linq;
using System.Runtime.InteropServices;

using Rhino.DocObjects;
using Rhino.Collections;
using GH_IO;
using GH_IO.Serialization;
// using Newtonsoft.Json;
# ---------- c_script: C# ----------
    if (read)
    {
      if (url == null) return;

      System.Net.ServicePointManager.Expect100Continue = true;
      System.Net.ServicePointManager.SecurityProtocol = System.Net.SecurityProtocolType.Tls12; //the auth type

      var request = System.Net.WebRequest.Create(url);
      // If required by the server, set the credentials.
      request.Credentials = System.Net.CredentialCache.DefaultCredentials;
      // Get the response.
      var response = (System.Net.HttpWebResponse) request.GetResponse();
      // Display the status.
      Console.WriteLine(response.StatusDescription);
      // Get the stream containing content returned by the server.
      Stream dataStream = response.GetResponseStream();
      // Open the stream using a StreamReader for easy access.
      StreamReader reader = new StreamReader (dataStream);
      // Read the content.
      A = reader.ReadToEnd();

      reader.Close();
      dataStream.Close();
      response.Close();
    }
# ---------- c_script: C# additional code ----------
  public class RootObject
  {
    public List<string> labels { get; set; }
    public List<List<double>> points { get; set; }
  }
# ---------- end c_script ----------

# ---- group: Read JSON File
from_json = FromJSON(JSON=c_script.A)
panel = Panel(from_json)

# ----
ghpython_script = GhPythonScript(xJSON=panel)  # -> simplify(flatten(lines)), chin_list, left_brow_list, right_brow_list, nose_bridge_list, nose_tip_list, left_eye_list, right_eye_list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
# ---------- ghpython_script: Python ----------
__author__ = "jiang"
__version__ = "2019.11.03"
        
import rhinoscriptsyntax as rs
import Rhino
import json
        
x = json.loads(xJSON)
components = {'chin': [],
              'left_brow': [],
              'right_brow': [],
              'nose_bridge': [],
              'nose_tip': [],
              'left_eye': [],
              'right_eye': [],
              'top_lip': [],
              'bottom_lip': []}
        
labels = x["labels"]
points = x["points"]
        
allPoints = []
for p in points:
    pointID = rs.AddPoint(0, p[0] * 1000, p[1] * 1000)
    allPoints.append(pointID)
        
for label in labels:
    for checker in components:
        if checker in label:
            components[checker].append([round(1000 * x)/1000 for x in points[labels.index(label)]])
            break
        
chin_list = components['chin']
left_brow_list = components['left_brow']
right_brow_list = components['right_brow']
nose_bridge_list = components['nose_bridge']
nose_tip_list = components['nose_tip']
left_eye_list = components['left_eye']
right_eye_list = components['right_eye']
top_lip_list = components['top_lip']
bottom_lip_list = components['bottom_lip']
        
curves = []
        
for component in components:
    lists = components[component]
    for i in range(len(lists) - 1, -1, -1):
        temp_1 = lists[i]
        temp_2 = lists[i-1]
        # tempLine = rs.AddLine((0, temp_1[0] * 1000, temp_1[1] * 1000), (0, temp_2[0] * 1000, temp_2[1] * 1000))
        tempLine = Rhino.Geometry.Line(Rhino.Geometry.Point3d(0, temp_1[0] * 1000, temp_1[1] * 1000), Rhino.Geometry.Point3d(0, temp_2[0] * 1000, temp_2[1] * 1000))
        curves.append(tempLine)

lines = curves
print(lines)
# ---------- end ghpython_script ----------
panel_2 = Panel(ghpython_script.lines)
panel_3 = Panel(ghpython_script.allPoints)
point_list = PointList(Points=panel_3, Size=10)
